# Dynamo custom node Element.SlabShapeByPoints.dyf (Dynamo 2.19.3.6394)
# category: Clockwork.Revit.Elements.Actions
# Transform the slab shape of a roof, floor slab or toposolid based on a list of Points.
# packages: Clockwork for Dynamo 3.x 3.3.0

points = Input(points: Autodesk.DesignScript.Geometry.Point[]..[])
element = Input(element: var[]..[])
version = Custom[Application.Version]()  # package Clockwork for Dynamo 3.x; Retrieves the name, version and build of the current Revit application.
python_script = Python(IN[0]=points, IN[1]=element, IN[2]=version.Version)  # CPython3
# ---------- python_script.python (44 lines) ----------
import clr
clr.AddReference('RevitAPI')
from Autodesk.Revit.DB import *

clr.AddReference("RevitNodes")
import Revit
clr.ImportExtensions(Revit.GeometryConversion)

clr.AddReference("RevitServices")
import RevitServices
from RevitServices.Persistence import DocumentManager
from RevitServices.Transactions import TransactionManager

def AddPointToSlabShape(item, point):
    if hasattr(item, "SlabShapeEditor"): sle = item.SlabShapeEditor
    elif hasattr(item, "GetSlabShapeEditor"): sle = item.GetSlabShapeEditor()
    else: return False
    sle.Enable()
    doc.Regenerate()
    p = point.ToXyz()
    try:
        if version > 2024: vertex = sle.AddPoint(p)
        else: vertex = sle.DrawPoint(p)
        if vertex.Position.IsAlmostEqualTo(p): return True
        else: return False
    except: return False

doc = DocumentManager.Instance.CurrentDBDocument
items = UnwrapElement(IN[1])
version = IN[2]

TransactionManager.Instance.EnsureInTransaction(doc)
if isinstance(IN[1], list):
    if isinstance(IN[0], list):
        OUT = []
        for item, points in zip(items, IN[0]):
            if isinstance(points, list): OUT.append((item, [AddPointToSlabShape(item, x) for x in points]))
            else: OUT.append((item, AddPointToSlabShape(item, points)))
    else: OUT = [(x, AddPointToSlabShape(x, IN[0])) for x in items]
    OUT = map(list, zip(*OUT))
else:
    if isinstance(IN[0], list): OUT = items, [AddPointToSlabShape(items, x) for x in IN[0]]
    else: OUT = items, AddPointToSlabShape(items, IN[0])
TransactionManager.Instance.TransactionTaskDone()
# ----------------------------------------
firstItem = List.FirstItem(list=python_script)
roof = Output(firstItem)
lastItem = List.LastItem(list=python_script)
success = Output(lastItem)
